# Grasshopper definition assignment-01.gh (Grasshopper 1.0.8)

# ---- group: Auto-reloads cdf module on VScode changes
# Setting path for Src AutoReloader: 1. Right click on Path
# 2. Choose "Select a directory"
# 3. Locate the ..\cdf1_teaching\src folder in your computer
# Assignment-01: Bauhaus
path = FilePath("C:\Users\gumbe\workspace\cdf1_teaching\cdf1_teaching\src\")
autoreloader = Python3Script(src_path=path)  # -> out; inputs src_path: String
# ---------- autoreloader: Python ----------
#! python3
import sys, os, time
import scriptcontext as sc
import Rhino, System
from System.IO import FileSystemWatcher, NotifyFilters

VERSION = 1  
pkg = "cdf"

if not src_path:
    raise Exception("Connect a folder to src_path.")
path = os.path.normpath(src_path)
watch_dir = os.path.join(path, pkg)
if not os.path.isdir(watch_dir):
    raise Exception("No '{}' folder found in:\n{}".format(pkg, path))

def unload():
    for name in list(sys.modules):
        if name == pkg or name.startswith(pkg + "."):
            del sys.modules[name]

# Put this folder first in Python's search list
if path in sys.path:
    sys.path.remove(path)
sys.path.insert(0, path)

key = "cdf_watcher_" + str(ghenv.Component.InstanceGuid)
time_key = key + "_time"
version_key = key + "_version"

def stamp():
    sc.sticky[time_key] = time.strftime("%Y-%m-%d %H:%M:%S")

# Replace the old watcher if the folder changed or the script was updated
old = sc.sticky.get(key)
if old is not None and (os.path.normpath(old.Path) != watch_dir
                        or sc.sticky.get(version_key) != VERSION):
    old.Dispose()
    del sc.sticky[key]
    unload()

if key not in sc.sticky:
    comp = ghenv.Component
    last = [0.0]

    def reload_and_rerun():
        unload()
        stamp()
        doc = comp.OnPingDocument()
        if doc is None:            # reloader was deleted or the file closed
            return
        for obj in doc.Objects:
            if "Python" in obj.GetType().Name:
                obj.ExpireSolution(False)   # mark as out of date
        doc.NewSolution(False)              # recompute once

    def on_change(sender, e):
        if not e.FullPath.endswith(".py") or "__pycache__" in e.FullPath:
            return
        if time.time() - last[0] < 0.5:     # ignore the second event of a double save
            return
        last[0] = time.time()
        Rhino.RhinoApp.InvokeOnUiThread(System.Action(reload_and_rerun))

    w = FileSystemWatcher(watch_dir, "*.py")
    w.IncludeSubdirectories = True
    w.NotifyFilter = NotifyFilters.LastWrite
    w.Changed += on_change
    w.EnableRaisingEvents = True
    sc.sticky[key] = w
    sc.sticky[version_key] = VERSION
    stamp()                                  # time the watcher started

msg = "Last reloaded: {}\nWatching: {}".format(sc.sticky.get(time_key, "unknown"), watch_dir)
print(msg)
out = msg
# ---------- end autoreloader ----------
panel = Panel(autoreloader)

# ----
containertype = Slider(1, range=0..2)
boxsize = Slider(300, range=100..500)
boxheight = Slider(100, range=100..500)
seed = Slider(7, range=0..10)
min_radius = Slider(5, range=5..35)
min_radius_2 = Slider(20, range=5..35)
wall_thickness = Slider(5, range=0.1..5)
countspheres = Slider(50, range=5..350)
python_3_script = Python3Script(size=boxsize, height=boxheight, wall_thickness=wall_thickness, container_type=containertype)  # -> out, a
# ---------- python_3_script: Python ----------
from cdf import create_hollow_container

a = create_hollow_container(container_type, size, height, wall_thickness)
# ---------- end python_3_script ----------
container_type = Python3Script(container_type=containertype, size=boxsize, height=boxheight)  # -> out, a
# ---------- container_type: Python ----------
# import function
from cdf import create_container

# call function
a = create_container(container_type=container_type, size=size, height=height)
# ---------- end container_type ----------
gravity_spheres = Python3Script(
    container_type=containertype,
    size=boxsize,
    height=boxheight,
    min_radius=min_radius,
    max_radius=min_radius_2,
    count=countspheres,
    seed=seed)  # -> a, b, c
# ---------- gravity_spheres: Python ----------
from cdf import pack_gravity_spheres

planes, radii = pack_gravity_spheres(
    container_type=container_type,
    size=size,
    height=height,
    count=count,
    min_radius=5.0,
    max_radius=20.0,
    seed=seed
)

a = planes
b = radii

outside = []
half = 30.0 / 2.0

for i, (plane, radius) in enumerate(zip(planes, radii)):
    point = plane.Origin
    if (abs(point.X) + radius > half + 1e-6
            or abs(point.Y) + radius > half + 1e-6
            or point.Z < radius - 1e-6
            or point.Z > 30.0 - radius + 1e-6):
        outside.append((i, point, radius))

c = outside
# ---------- end gravity_spheres ----------

# ---- group: randomizer Material ID
# Note: In hindsight, generating custom materials in the script was unnecessarily complicated; I could have used different Custom Preview components in Grasshopper. I wanted the GH file to be fully self-contained for the instructors, but manually assigning materials for rendering in Rhino after baking the geometry would have (probably) been perfectly sufficient.
list_length = ListLength(List=gravity_spheres.a)
equalizer = Python3Script(count=list_length, seed=seed)  # -> out, a
# ---------- equalizer: Python ----------
from random import Random

count = int(count)
rng = Random(seed)

material_ids = [i % 5 for i in range(count)]
rng.shuffle(material_ids)

a = material_ids
# ---------- end equalizer ----------
panel_2 = Panel(equalizer.a)

# ----
python_3_script_2 = Python3Script(planes=gravity_spheres.a, radii=gravity_spheres.b, seed=seed)  # -> out, a; inputs planes: list, radii: list
# ---------- python_3_script_2: Python ----------
from cdf import perforate_spheres

a = perforate_spheres(planes, radii)
# ---------- end python_3_script_2 ----------
bake = Button()
bake_2 = Python3Script(material_ids=equalizer.a, box_brep=python_3_script.a, sphere_breps=python_3_script_2.a, bake=bake)  # -> out, a; inputs material_ids: list, box_brep: Brep, sphere_breps: list of Brep
# ---------- bake_2: Python ----------
from cdf import bake_composition_on_button

a = bake_composition_on_button(
    box_brep,
    sphere_breps,
    material_ids,
    bake
)
# ---------- end bake_2 ----------
